# Dynamo custom node CreateSheets.dyf (Dynamo 2.5.0.7460)
# category: UBetter.Revit.Sheets
# Create multiple sheets

familytype = Input(familytype: var[]..[] = Null)  # Titleblock Family to provide
name = Input(name: var[]..[] = [])  # Sheet Name
number = Input(number: var[]..[] = [])  # Sheet Number
python_script = Python(IN[0]=familytype, IN[1]=name, IN[2]=number)
# ---------- python_script.python (56 lines) ----------
# Made by Nicolas Yuvero
# Free to use

import clr

#Import ToDSType(bool) extension method
clr.AddReference("RevitNodes")
import Revit
clr.ImportExtensions(Revit.Elements)
#Import geometry conversion exetension methods
clr.ImportExtensions(Revit.GeometryConversion)


#Import DocumentManager and TransactionManager
clr.AddReference("RevitServices")
#import RevitServices
from RevitServices.Persistence import DocumentManager
from RevitServices.Transactions import TransactionManager

#Import Revit API
clr.AddReference("RevitAPI")
#import Autodesk
from Autodesk.Revit.DB import *
from Autodesk.Revit.Creation import *


#Standard areas for Current Document, Active UI and application
doc = DocumentManager.Instance.CurrentDBDocument


#Input and Unwrapping
ttblock_dyn = IN[0]
vname = IN[1] if isinstance(IN[1],list) else [IN[1]]
vnumb = IN[2] if isinstance(IN[2],list) else [IN[2]]

ttblock_rvt = UnwrapElement(ttblock_dyn).Id

sheets_dyn = []

#Start Transaction
TransactionManager.Instance.EnsureInTransaction(doc)

for vn, vu in zip(vname, vnumb):

	sheet = ViewSheet.Create(doc, ttblock_rvt)
	sheet.Name = vn
	sheet.SheetNumber = vu
	
	sheets_dyn.append(sheet.ToDSType(False))

	
#End Transaction
TransactionManager.Instance.TransactionTaskDone()


OUT = sheets_dyn
# ----------------------------------------
elements = Output(python_script)
