# Dynamo custom node ElemGetScheduleParameters.dyf (Dynamo 2.5.0.7460)
# category: UBetter.Parameters
# Given an element obtains basic information quantities: Category, Family, Type, Length, Area y Volume

element = Input(element: var[]..[])
elementType = Element.ElementType(element=element)

# group: Category, Type & Family name Params
code_block = CodeBlock { "Type Name"; }
getParameterValueByName = Element.GetParameterValueByName(element=elementType, parameterName=code_block)
code_block_2 = CodeBlock { "Family Name"; }
getParameterValueByName_2 = Element.GetParameterValueByName(element=elementType, parameterName=code_block_2)
getCategory = Element.GetCategory(element=element)

code_block_3 = CodeBlock(x=getParameterValueByName) { x==""; "No tiene Tipo"; }
if_ = If(test=code_block_3.out0, true=code_block_3.out1, false=getParameterValueByName)
typeName = Output(if_)
code_block_4 = CodeBlock(x=getParameterValueByName_2) { x==""; "No tiene Familia"; }
if_2 = If(test=code_block_4.out0, true=code_block_4.out1, false=getParameterValueByName_2)
FamilyName = Output(if_2)

# group: Quantity Params
code_block_5 = CodeBlock { "Area"; }
getParameterValueByName_3 = Element.GetParameterValueByName(element=element, parameterName=code_block_5)
code_block_6 = CodeBlock { "Length"; }
getParameterValueByName_4 = Element.GetParameterValueByName(element=element, parameterName=code_block_6)
code_block_7 = CodeBlock { "Volume"; }
getParameterValueByName_5 = Element.GetParameterValueByName(element=element, parameterName=code_block_7)

# group: Condition in case the values not exists
code_block_8 = CodeBlock(x=getParameterValueByName_3) { x==""; 0; }
if_3 = If(test=code_block_8.out0, true=code_block_8.out1, false=getParameterValueByName_3)
code_block_9 = CodeBlock(x=getParameterValueByName_4) { x==""; 0; }
if_4 = If(test=code_block_9.out0, true=code_block_9.out1, false=getParameterValueByName_4)
code_block_10 = CodeBlock(x=getParameterValueByName_5) { x==""; 0; }
if_5 = If(test=code_block_10.out0, true=code_block_10.out1, false=getParameterValueByName_5)

elementArea = Output(if_3)
elementLength = Output(if_4)
Elementvolume = Output(if_5)
categoryName = Output(getCategory)
