# Dynamo custom node FamilyTypeMapping.dyf "FamilyTypeMaping" (Dynamo 2.5.0.7460)
# category: UBetter.Element
# Given a multiple Elements selection, maps quantities per family type

elements = Input(elements: var[]..[])

# group: Family type Grouping
elementType = Element.ElementType()  # unwired: element
groupByFunction = List.GroupByFunction(list=elements, func=elementType)

elementGetShcheduleParameters = Custom[ElementGetShcheduleParameters](element=groupByFunction)  # Given an element obtains basic information quantities: Category, Family, Type, Length, Area y Volume

# group: Lists Mapping
count = List.Count()  # unwired: list
map = List.Map(list=elementGetShcheduleParameters.categoryName, f_x=count)
firstItem = List.FirstItem()  # unwired: list
map_2 = List.Map(list=elementGetShcheduleParameters.typeName, f_x=firstItem)
firstItem_2 = List.FirstItem()  # unwired: list
map_3 = List.Map(list=elementGetShcheduleParameters.categoryName, f_x=firstItem_2)
firstItem_3 = List.FirstItem()  # unwired: list
map_4 = List.Map(list=elementGetShcheduleParameters.FamilyName, f_x=firstItem_3)
sum = Math.Sum()  # unwired: values
map_5 = List.Map(list=elementGetShcheduleParameters.elementLength, f_x=sum)
sum_2 = Math.Sum()  # unwired: values
map_6 = List.Map(list=elementGetShcheduleParameters.elementArea, f_x=sum_2)
sum_3 = Math.Sum()  # unwired: values
map_7 = List.Map(list=elementGetShcheduleParameters.Elementvolume, f_x=sum_3)

categories_quantities = Output(map)
type_name = Output(map_2)
categories = Output(map_3)
family_name = Output(map_4)
total_length = Output(map_5)
total_area = Output(map_6)
total_volume = Output(map_7)
