# Dynamo custom node GetTypesQuantities.dyf (Dynamo 2.5.0.7460)
# category: UBetter.Parameters
# Obtiene un cómputo a partir de los elementos seleccionados, agrupados por Tipo de familia: Categoria, Familia, Tipo, Cantidades, SUM Longitud, SUM Areas y SUM Volumen

elements = Input(elements: var[]..[])

# group: Agrupar por tipo de familia
# note: La funcion en este caso es ElementType, no hace falta que tenga un input este nodo es solo para cargar la funcion
elementType = Element.ElementType()  # unwired: element
groupByFunction = List.GroupByFunction(list=elements, func=elementType)

elementGetShcheduleParameters = Custom[ElementGetShcheduleParameters](element=groupByFunction)  # A partir de un elemento se obtiene la información básica de cómputo: Categoría, Familia, Tipo, Longitud, Área y Volumen

# group: Mapeo de las listas
firstItem = List.FirstItem()  # unwired: list
# note: Nombre de todas las categorias seleccionadas
map = List.Map(list=elementGetShcheduleParameters.categoryName, f_x=firstItem)
firstItem_2 = List.FirstItem()  # unwired: list
# note: Nombre de todos los tipos seleccionados
# note: Cuenta la cantidad de elementos por Categoria
map_2 = List.Map(list=elementGetShcheduleParameters.typeName, f_x=firstItem_2)
firstItem_3 = List.FirstItem()  # unwired: list
# note: Suma todas las longitudes
map_3 = List.Map(list=elementGetShcheduleParameters.FamilyName, f_x=firstItem_3)
sum = Math.Sum()  # unwired: values
# note: Suma todas las Areas
map_4 = List.Map(list=elementGetShcheduleParameters.elementLength, f_x=sum)
sum_2 = Math.Sum()  # unwired: values
# note: Suma todos los Volumenes
map_5 = List.Map(list=elementGetShcheduleParameters.elementArea, f_x=sum_2)
# note: Reemplaza la lista por un valor asignado
sum_3 = Math.Sum()  # unwired: values
map_6 = List.Map(list=elementGetShcheduleParameters.Elementvolume, f_x=sum_3)
# note: Devuelve los parametros clasificados por tipo de familia
count = List.Count()  # unwired: list
# note: Nombre de todas las familias seleccionadas
map_7 = List.Map(list=elementGetShcheduleParameters.categoryName, f_x=count)

categories = Output(map)
type_name = Output(map_2)
family_name = Output(map_3)
total_length = Output(map_4)
total_area = Output(map_5)
total_volume = Output(map_6)
categories_quantities = Output(map_7)
