# Dynamo custom node IsolateClashes.dyf (Dynamo 2.5.0.7460)
# category: UBetter.View
# Isolates in view all the clashing elements as per Clash detectiond Report given
# packages: Universo_BIM 19.10.11

report = Input(report: var[]..[] = Null)  # Clash Detection Report path (HTML) to provide
getElements = Analysis.Collision_Report.getElements(path=report)
list_create = List.Create(item0=getElements.Element_1, item1=getElements.Element_2)
flatten = List.Flatten(list=list_create)
view = Input(view: var[]..[])  # View to display
python_script = Python(IN[0]=flatten, IN[1]=view)
# ---------- python_script.python (27 lines) ----------
import clr
clr.AddReference('RevitAPI')
from Autodesk.Revit.DB import *
from System.Collections.Generic import *

clr.AddReference("RevitServices")
import RevitServices
from RevitServices.Persistence import DocumentManager
from RevitServices.Transactions import TransactionManager

def TempIsolateElements(view, items):
	if not items: return False
	elif not isinstance(items, list): items = [items]
	ielements = List[ElementId]([x.Id for x in UnwrapElement(items)])
	try:
		UnwrapElement(view).IsolateElementsTemporary(ielements)
		return True
	except: return False

doc = DocumentManager.Instance.CurrentDBDocument

TransactionManager.Instance.EnsureInTransaction(doc)
if isinstance(IN[1], list):
	if isinstance(IN[0], list): OUT = [TempIsolateElements(x, y) for x, y in zip(IN[1], IN[0])]
	else: OUT = [TempIsolateElements(x, IN[0]) for x in IN[1]]
else: OUT = TempIsolateElements(IN[1], IN[0])
TransactionManager.Instance.TransactionTaskDone()
# ----------------------------------------
success = Output(python_script)
element = Output(flatten)
