# Dynamo custom node RandomNumber.dyf (Dynamo 2.5.0.7460)
# category: UBetter.Operations
# Populates through random numers between two values (max & min)

count = Input(count: int = 10)  # Number of values to generate
seed = Input(seed: int = 1)  # Seed of randomisation
min = Input(min: double = 0)  # Lower value of the domain
max = Input(max: double = 20)  # Upper value of the domain
python_script = Python(IN[0]=count, IN[1]=seed, IN[2]=min, IN[3]=max)
# ---------- python_script.python (27 lines) ----------
# Made by Nicolas Yuvero
# Free for use

# Import random package
from random import seed
from random import random


# Define inputs
rcount = int(IN[0])
rseed = IN[1]
rmin = IN[2]
rmax = IN[3]

# Set seed
seed(rseed)

# Empty list for values
nums = []

# Generate random values
for r in range(rcount):
	val = rmin + round((random()*rmax-rmin),2)
	nums.append(val)
	
# Output
OUT = nums
# ----------------------------------------
values = Output(python_script)
