# Dynamo custom node SurfacesSorter.dyf (Dynamo 2.5.0.7460)
# category: UBetter.Element
# Given an element sorts out whether its faces are Superior, inferior or sides

element = Input(element: var[]..[])

# group: Faces Selection
geometry = Element.Geometry(element=element)
faces = Topology.Faces(topology=geometry)
flatten = List.Flatten(list=faces)
surfaceGeometry = Face.SurfaceGeometry(face=flatten)

# group: Normal Vectors
baricentro_de_la_superficie = CodeBlock { 0.5; }
normalAtParameter = Surface.NormalAtParameter(surface=surfaceGeometry, u=baricentro_de_la_superficie, v=baricentro_de_la_superficie)

# group: is ZAxis Perpendicular
ZAxis = Vector.ZAxis()
isParallel = Vector.IsParallel(vector=normalAtParameter, other=ZAxis)
filterByBoolMask = List.FilterByBoolMask(list=surfaceGeometry, mask=isParallel)

laterales = Output(filterByBoolMask.out)

# group: Faces Normal Vector
baricentro_de_la_superficie_2 = CodeBlock { 0.5; }
normalAtParameter_2 = Surface.NormalAtParameter(surface=filterByBoolMask.in, u=baricentro_de_la_superficie_2, v=baricentro_de_la_superficie_2)

# group: Filter
Z = Vector.Z(vector=normalAtParameter_2)
code_block = CodeBlock(z=Z) { z>0; }
filterByBoolMask_2 = List.FilterByBoolMask(list=filterByBoolMask.in, mask=code_block)

superior = Output(filterByBoolMask_2.in)
inferior = Output(filterByBoolMask_2.out)
